# Grasshopper definition MarchingCube.gh (Grasshopper 1.0.7)

trigger = Trigger(Interval=10, TimerInterval=10, Target=c_script)  # disabled
c_script = CSharpScript(
    reset=Toggle(True),
    size=Slider(30, range=0..100),
    alpha=Slider(1, range=0..10),
    beta=Slider(0.9, range=0..1),
    gamma=Slider(0, range=0..0.1),
    displayPeriod=Slider(75, range=0..100),
    Reference="C:\Users\jenny\source\repos\IAR5262_MarchingCube\IAR5262_MarchingCube\bin\Debug\IAR5262_MarchingCube.dll")  # -> out, snowflake; inputs reset: Boolean, size: Int32, alpha: Double, beta: Double, gamma: Double, displayPeriod: Int32
# ---------- c_script: C# usings ----------
using IAR5262_MarchingCube;
# ---------- c_script: C# ----------
    if(reset){
      prismGrid = new PrismGrid(size, zHeight, alpha, beta, gamma, iso);
      prismGrid.createUnitGrid();
      currentA = alpha;
      currentB = beta;
      currentG = gamma;
      frameCount = 0;
      Print("Reset");
    }

    else{
      if(!prismGrid.end){
        // check environment constants
        if(currentA != alpha || currentB != beta || currentG != gamma) {
          updateConstant = true;
          currentA = alpha;
          currentB = beta;
          currentG = gamma;
        }
        if(updateConstant) {
          prismGrid.grid.setConstant(alpha, beta, gamma);
          updateConstant = false;
        }

        // diffusion
        prismGrid.grid.checkReceptive();
        prismGrid.grid.run();
        prismGrid.checkDiffusionEnd();

        if(frameCount % displayPeriod == 0 || prismGrid.end){
          prismGrid.updateFeild();
          prismGrid.updateTableIndex();
          prismGrid.getOutMesh();
        }
      }
      else{
        Print("End");
      }
      snowflake = prismGrid.displayOutMesh();
    }
# ---------- c_script: C# additional code ----------
  PrismGrid prismGrid;
  int zHeight = 3;
  double iso = 1.0;
  double currentA;
  double currentB;
  double currentG;
  bool updateConstant = false;
  int frameCount = 0;
# ---------- end c_script ----------
panel = Panel(c_script.out)
mesh = Mesh(c_script.snowflake)
mjoin = MeshJoin(Meshes=mesh)  # disabled
